vi "Init.gvi"   [LabVIEW NXG 3.0.0]
# This VI creates a dam based on it’s last logged state in the input log path.
inputs:
  "Log Path": path
  "Error in": error
outputs:
  "Dam out": "Dam.gtype"
  "Error out": error
panel controls:
  "Report Data": "Report Data.gtype" = {"Lake properties"={"Lake Fill (Acre-feet)"=0, "Lake Intake Rate (cfs)"=0, "Lake Discharge Rate (cfs)"=0}, "Large Floodgates properties"={"# of Large Floodgates"=4, "Large Flodgates Size (cfs)"=0, "Large Floodgates Status"=[]}, "Small Floodgates properties"={"# of Small Floodgates"=5, "Small Floodgates Size (cfs)"=0, "Small Floodgates Status"=[]}, "Turbines properties"={"# of Turbines"=2, "Power at Max Flow (MW)"=0, "Turbine Gates Status"=[], "Turbines State (%)"=[], "Total Power Being Generated (MW)"=0}}
types:
  "Lake properties.gtype" = cluster{"Lake Fill (Acre-feet)": f64, "Lake Intake Rate (cfs)": f64, "Lake Discharge Rate (cfs)": f64}
  "Large Floodgates properties.gtype" = cluster{"# of Large Floodgates": i32, "Large Flodgates Size (cfs)": f64, "Large Floodgates Status": bool[]}
  "Small Floodgates properties.gtype" = cluster{"# of Small Floodgates": i32, "Small Floodgates Size (cfs)": f64, "Small Floodgates Status": bool[]}
  "Turbines properties.gtype" = cluster{"# of Turbines": i32, "Power at Max Flow (MW)": f64, "Turbine Gates Status": bool[], "Turbines State (%)": f64[], "Total Power Being Generated (MW)": f64}
  "Report Data.gtype" = cluster{"Lake properties": "Lake properties.gtype", "Large Floodgates properties": "Large Floodgates properties.gtype", "Small Floodgates properties": "Small Floodgates properties.gtype", "Turbines properties": "Turbines properties.gtype"}
uses:
  Lake.gtype::Init.gvi
  Turbine.gtype::Init.gvi
  Floodgate.gtype::Init.gvi
  Report.gtype::Open or Create.gvi
  Report.gtype::Read Last Status.gvi
diagram:
  Property Node(instance in=$"Report Data") -> ("Lake properties"=w1, "Large Floodgates properties"=w2, "Small Floodgates properties"=w3, "Turbines properties"=w4)
  case ($"Error in") {
    frame No Error {
      Property Node(instance in=w1) -> ("Lake Fill (Acre-feet)"=w7, "Lake Intake Rate (cfs)"=w8, "Lake Discharge Rate (cfs)"=w9)
      call "Init.gvi"(Fill (Acre-feet)=w7, Intake Rate (cfs)=w8, Discharge Rate (cfs)=w9, Error in=$"Error in") -> (Lake out=w10, Error out=w11)
      Property Node(instance in=w4) -> ("# of Turbines"=w12, "Power at Max Flow (MW)"=w13, "Turbine Gates Status"=w14, "Turbines State (%)"=w15)
      s1 = $"Error in"  # shift register
      for (N = w12) (iteration -> i1) {
        Array Index(array=w14) -> (out0[i1]=w17)
        Array Index(array=w15) -> (out0[i1]=w18)
        call "Init.gvi"(Power at Max Flow (MW)=w13, Gate State (FALSE = Closed)=w17, Open Percentage (%)=w18, Error in=s1) -> (Turbine out=w19, Error out=w20)
        append w19 to w16
        next s1 = w20
      }
      Property Node(instance in=w2) -> ("# of Large Floodgates"=w21, "Large Flodgates Size (cfs)"=w22, "Large Floodgates Status"=w23)
      s2 = $"Error in"  # shift register
      for (N = w21) (iteration -> i2) {
        Array Index(array=w23) -> (out0[i2]=w25)
        call "Init.gvi"(Size (cfs)=w22, State (FALSE = Closed)=w25, Error in=s2) -> (Floodgate out=w26, Error out=w27)
        append w26 to w24
        next s2 = w27
      }
      Property Node(instance in=w3) -> ("# of Small Floodgates"=w28, "Small Floodgates Size (cfs)"=w29, "Small Floodgates Status"=w30)
      s3 = $"Error in"  # shift register
      for (N = w28) (iteration -> i3) {
        Array Index(array=w30) -> (out0[i3]=w32)
        call "Init.gvi"(Size (cfs)=w29, State (FALSE = Closed)=w32, Error in=s3) -> (Floodgate out=w33, Error out=w34)
        append w33 to w31
        next s3 = w34
      }
      call "Open or Create.gvi"(Log Path=$"Log Path", Error in=$"Error in") -> (Report out=w35, Error out=w36)
      call "Read Last Status.gvi"(Report in=w35, Error in=w36) -> (Report out=w37, Error out=w38)
      Merge Errors(w38, w11, s2, s3, s1) -> (error out=w39)
      Property Node(instance in="Dam.gtype" constant, "Report"=w37, "Lake"=w10, "Turbines"=w16, "Large floodgates"=w24, "Small floodgates"=w31, error in=w39) -> (error out=w5, instance out=w6)
    }
    frame Error {
      w5 = $"Error in"
      w6 = "Dam.gtype" constant
    }
  }
  $"Dam out" <- w6
  $"Error out" <- w5
