vi "Open or Create.gvi"   [LabVIEW NXG 3.0.0]
# This VI takes in a report path and opens a reference to it. If it is not already created, it will create it and set the default data.
# If the report’s path it will default to <Public Documents>/Dam_Log.csv
inputs:
  "Log Path": path
  "Error in": error
outputs:
  "Report out": "Report.gtype"
  "Error out": error
uses:
  NI::G Core::File IO (General)::Get System Directory.gvi
diagram:
  case ($"Error in") {
    frame No Error {
      Is Empty String Or Path(string/path=$"Log Path") -> w3
      case (w3) {
        frame False, Default {
          w4 = $"Log Path"
        }
        frame True {
          call "Get System Directory.gvi"(type="Public Documents", create directory if not found?=FALSE) -> (system directory=w5)
          Build Path(base path=w5, name or relative path="Dam_Log.csv") -> (appended path=w4)
        }
      }
      Property Node(instance in="Report.gtype" constant, "Log Path"=w4, error in=$"Error in") -> (error out=w1, instance out=w2)
    }
    frame Error {
      w1 = $"Error in"
      w2 = "Report.gtype" constant
    }
  }
  $"Report out" <- w2
  $"Error out" <- w1
