vi "Main.gvi"   [LabVIEW NXG 3.0.0]
panel controls:
  "Stop": bool
  "Settings": i32
  "Inflow (cfs)": f64 = 1000
  "Large Floodgates Status": bool[] = [FALSE, FALSE, FALSE, FALSE]
  "Small Floodgates Status": bool[] = [FALSE, FALSE, FALSE, FALSE]
  "Turbines Status": bool[] = [FALSE, TRUE, FALSE, FALSE]
  "Turbines Open Gap (%)": f64[] = [41.8597271091, 60.594530904]
  "Reset": bool
panel indicators:
  "Lake Fill (Acre-feet)": f64
  "Inflow (cfs) reading": f64
  "Total Power Generation (MW)": f64
  "Log Path": path
  "Fill (Acre-feet)": f64
types:
  T1 = cluster{"Element 1": bool[], "Element 2": bool[]}
uses:
  NI::G Core::Error::Build Error Cluster.gvi
  Dam.gtype::Close.gvi
  Dam.gtype::Update Dam.gvi
  Dam.gtype::Log Status.gvi
  NI::G Core::Error::Clear Error Cluster.gvi
  Dam.gtype::Init.gvi
  Dam.gtype::Set Lake Inflow.gvi
  Dam.gtype::Set Turbines Status.gvi
  Dam.gtype::Set Floodgates Status.gvi
  NI::G Core::Error::Multiplex Errors.gvi
  NI::G Core::Error::Display Error.gvi
diagram:
  call "Open QMH.gvi"() -> (Message Queue=w1, Stop Event=w2, error out=w3)
  call "Send Message.gvi"(Queue in=w1, Command="Initialize", Data=FALSE, Input=w3) -> (Queue out=w4, Output=w5)
  Register For Events("Stop Event"=w2, error in=w5) -> (error out=w6, event registration refnum out=w7)
  s1 = w6  # shift register
  while {
    event (timeout = 50) (dynamic events = w7) {
      on "Stop" Value changed {
        call "Send Message.gvi"(Queue in=w4, Command="Stop", Data=s1, Input=s1) -> (Output=w9)
        # This case sends a stop to the dam
        # It DOES NOT stop the consumer loop
        w8 = default
      }
      on "Dynamic" Stop Event {
        # This case stops the consumer loop
        # We make sure this can only happen if the producer loop stops too
        Event Data() -> ("event data"=w8)
        w9 = s1
      }
      on Timeout {
        call "Update Dam and Log.gvi"(Message Queue In=w4, Dam Update Time=1, Log Time=60, Error Input=s1) -> (Error Output=w9)
        # This case is used to keep the dam updated
        # Configure here the timing in which we refresh the dam
        # and the timing in which we log.
        w8 = default
      }
      on "Reset" Value changed {
        call "Send Message.gvi"(Queue in=w4, Command="Initialize", Data=$Reset, Input=s1) -> (Output=w9)
        # This case sends a reset to the dam
        # It sets all values to the default data
        w8 = default
      }
      on "Inflow (cfs)" Value changed {
        call "Send Message.gvi"(Queue in=w4, Command="Change Inflow", Data=$"Inflow (cfs)", Input=s1) -> (Output=w9)
        # This case sends a new inflow to the dam
        w8 = default
      }
      on "Turbines Open Gap (%)" Value changed; "Turbines Status" Value changed {
        Build Cluster($"Turbines Status", $"Turbines Open Gap (%)") -> w10
        # This case sends a new turbine settings to the dam
        call "Send Message.gvi"(Queue in=w4, Command="ChangeTurbines Status", Data=w10, Input=s1) -> (Output=w9)
        w8 = default
      }
      on "Large Floodgates Status" Value changed; "Small Floodgates Status" Value changed {
        Build Cluster($"Large Floodgates Status", $"Small Floodgates Status") -> w11
        # This case sends new floodgate settings to the dam
        call "Send Message.gvi"(Queue in=w4, Command="Change Floodgates Status", Data=w11, Input=s1) -> (Output=w9)
        w8 = default
      }
    }
    call "Error Check.gvi"(Message Queue In=w4, Error In=w9) -> (Message Queue Out=w12, Error Output=w13)
    next s1 = w13
    stop if w8
  }
  s2 = "Dam.gtype" constant  # shift register
  while {
    call "Read Message.gvi"(Message Queue In=w4, Error in=w6) -> (Message Queue Out=w14, Command=w15, Data=w16, Error out=w17)
    case (w15) {
      frame Default {
        # This case executes when an undefined command arrives
        Format Into String(initString="Unknown command received: ", errIn=w17, w15) -> (outString=w21, errOut=w22)
        call "Build Error Cluster.gvi"(error in=w22, code=5000, description=w21) -> (error out=w18)
        w19 = default
        w20 = s2
      }
      frame "Stop" {
        Variant To Data(error in (no error)=w17, type=w17, variant=w16) -> (data=w23, error out=w24)
        Generate User Event(error in=w24, event data=TRUE, user event=w2) -> (error out=w25)
        call "Close.gvi"(Dam in=s2, Error in=w25) -> (Error out=w26)
        # This case stops the dam and sends a stop command to the producer loop
        Merge Errors(w23, w26) -> (error out=w18)
        w19 = TRUE
        w20 = "Dam.gtype" constant
      }
      frame "Update Dam" {
        call "Update Dam.gvi"(Dam in=s2, Error in=w17) -> (Dam out=w20, Fill (Acre-feet)=w27, Power Generated (MW)=w28, Error out=w18)
        $"Fill (Acre-feet)" <- w27
        $"Lake Fill (Acre-feet)" <- w27
        # This case should be run every second to make sure the dam updates its levels every second.
        $"Total Power Generation (MW)" <- w28
        w19 = default
      }
      frame "Log" {
        # This case asks the dam to log its state into its report
        call "Log Status.gvi"(Dam in=s2, Error in=w17) -> (Dam out=w20, Error out=w18)
        w19 = default
      }
      frame "Initialize" {
        Clear Data(reference in=reference to "Lake Fill (Acre-feet)") -> (error out=w29)
        call "Clear Error Cluster.gvi"(error in=w29)
        Variant To Data(type=bool FALSE, variant=w16) -> (data=w30, error out=w31)
        call "Init.gvi"(Reset?=w30, Error in=w17) -> (Dam's data=w32, Dam out=w20, Log Path Out=w33, Error out=w18)
        $"Log Path" <- w33
        call "Clear Error Cluster.gvi"(error in=w31)
        Property Node(instance in=w32) -> ("Lake properties"=w34, "Large Floodgates properties"=w35, "Small Floodgates properties"=w36, "Turbines properties"=w37)
        Property Node(instance in=w34) -> ("Lake Intake Rate (cfs)"=w38)
        $"Inflow (cfs) reading" <- w38
        $"Inflow (cfs)" <- w38
        # This case initializes a new dam.
        # You can use it to reset it to its default values, too
        Property Node(instance in=w35) -> ("Large Floodgates Status"=w39)
        $"Large Floodgates Status" <- w39
        Property Node(instance in=w36) -> ("Small Floodgates Status"=w40)
        $"Small Floodgates Status" <- w40
        Property Node(instance in=w37) -> ("Turbine Gates Status"=w41, "Turbines State (%)"=w42)
        $"Turbines Status" <- w41
        $"Turbines Open Gap (%)" <- w42
        w19 = default
      }
      frame "Change Inflow" {
        Variant To Data(error in (no error)=w17, type=f64 0, variant=w16) -> (data=w43, error out=w44)
        call "Set Lake Inflow.gvi"(Dam in=s2, Intake Rate (cfs)=w43, Error in=w44) -> (Dam out=w20, Intake Rate out (cfs)=w45, Error out=w18)
        # Use this case to change the inflow rate of the dam
        $"Inflow (cfs) reading" <- w45
        w19 = default
      }
      frame "ChangeTurbines Status" {
        # Use this case to change the turbines status of the dam
        w46 = cluster{"Element 1": bool[], "Element 2": f64[]} {all zero or empty}
        Variant To Data(error in (no error)=w17, type=w46, variant=w16) -> (data=w47, error out=w48)
        Property Node(instance in=w47) -> ("Element 1"=w49, "Element 2"=w50)
        call "Set Turbines Status.gvi"(Dam in=s2, Turbines Status=w49, Turbine Gates=w50, Error in=w48) -> (Dam out=w20, Turbines Status Out=w51, Turbine Gates Out=w52, Error out=w18)
        $"Turbines Status" <- w51
        $"Turbines Open Gap (%)" <- w52
        w19 = default
      }
      frame "Change Floodgates Status" {
        # Use this case to change the turbines status of the dam
        Variant To Data(error in (no error)=w17, type=T1 {all zero or empty}, variant=w16) -> (data=w53, error out=w54)
        Property Node(instance in=w53) -> ("Element 1"=w55, "Element 2"=w56)
        call "Set Floodgates Status.gvi"(Dam in=s2, Large Floodgates Status=w55, Small Floodgates Status=w56, Error in=w54) -> (Dam out=w20, Large Floodgates Status Out=w57, Small Floodgates Status Out=w58, Error out=w18)
        $"Large Floodgates Status" <- w57
        $"Small Floodgates Status" <- w58
        w19 = default
      }
    }
    call "Error Check.gvi"(Message Queue In=w14, Error In=w18) -> (Error Output=w59)
    next s2 = w20
    stop if w19
  }
  call "Multiplex Errors.gvi"(error in 1=s1, error in 2=w59) -> (error out=w60)
  Unregister For Events(error in=w60, event registration refnum=w7) -> (error out=w61)
  call "Close QMH.gvi"(Message Queue=w12, Stop Event=w2, error in=w61) -> (error out=w62)
  call "Display Error.gvi"(error in=w62)
