vi "Main.gviweb"   [LabVIEW NXG 3.0.0]
# This template is for the Queued Message Handler design pattern. The Event Handling Loop generates messages based on user interface actions. The Message Handling Loop processes messages generated by the Event Handling Loop, or by other messages. The messages are string values, so new messages can be added easily to the Message Cases case structure in the Message Handling Loop. Each message cluster can also provide an optional value for Message Data,  which is a String that can be swapped to whatever type of data is required.
panel controls:
  "Exit": bool
  "Tasks": i32
  "Clear Faults": bool
  "Robot ON/OFF": bool
  "Fail Setting": T1 = "Retry"
  "Add Tasks": i32
  "Tee Holes": bool[] = [FALSE, FALSE, FALSE, FALSE, FALSE, FALSE, FALSE, FALSE, FALSE]
  "Sand Traps": bool[] = [FALSE, FALSE, FALSE]
  "Patch All Tee Holes": bool
  "Patch Selected Tee Holes": bool
  "Rake All Sand Traps": bool
  "Rake Selected Sand Traps": bool
  "Retrieve Balls": bool
panel indicators:
  "Pending Tasks": string[]
  "Completed Tasks": string[]
  "Faults and alerts": string[]
  "Sequence Progress": f64
  "Robot Status": string
types:
  T1 = enum{"Retry", "Alert", "Alert and Retry", "Ignore"}
  "Robot Status.gtype" = enum{"Off", "Idle", "Running", "Paused", "Error"}
  "Task Types.gtype" = enum{"Patch Tee Hole", "Rake Sand Trap", "Retrieve Balls from Creek"}
  "Task Status.gtype" = enum{"Waiting", "Running", "Completed", "Failed"}
  "Task Data.gtype" = cluster{"Task Type": "Task Types.gtype", "Remaining time (s)": f64, "Status": "Task Status.gtype", "Index": u32, "Start Time": timestamp, "End Time": timestamp}
  "Robot Data.gtype" = cluster{"Start Time": timestamp, "Robot Status": "Robot Status.gtype", "Completed Tasks": "Task Data.gtype"[], "Tasks in Queue": "Task Data.gtype"[], "Alerts": error[]}
uses:
  Application::support::Message Queue::Create All Message Queues.gviweb
  Application::support::Message Queue::Dequeue Message.gviweb
  NI::G Core::Error::Build Error Cluster.gvi
  Application::support::Message Queue::Enqueue Message (Single).gviweb
  Application::Robot functions::Parse Faults and Alerts.gviweb
  NI::G Core::Error::Clear Error Cluster.gvi
  Application::support::Error Handler - Message Handling Loop.gviweb
  Application::support::Error Handler - Event Handling Loop.gviweb
diagram:
  w1 = bool FALSE  # Stop Event
  Create User Event[EventName="Stop Event"](user event data type=w1) -> (error out=w2, user event out=w3)
  w4 = "Robot Data.gtype" {"Start Time"=1904-01-01T00:00:00Z, "Robot Status"="Idle", "Completed Tasks"=[], "Tasks in Queue"=[], "Alerts"=[]}  # Robot Data
  call "Create All Message Queues.gviweb"(error in=w2) -> (message queues=w5, error out=w6)
  Property Node(instance in=w5) -> ("message queue"=w7)
  s1 = w4  # shift register
  while {
    # w3: Stop Event
    # s1: Data
    call "Dequeue Message.gviweb"(message queue in=w7, error in=w6) -> (message queue out=w8, message=w9, message data=w10, error out=w11)
    case (w9) ignore case {  # Message Cases
      frame Default {
        w15 = "The invalid message string \"%s\" was received in the Message Handling Loop."
        Format Into String(formatString=w15, w9) -> w16
        call "Build Error Cluster.gvi"(code=1, description=w16) -> (error out=w12)
        w13 = s1
        w14 = default
      }
      frame "Initialize" {
        call "Enqueue Message (Single).gviweb"(message queue in=w8, message="Update Display", error in=w11) -> (error out=w12)
        w13 = s1
        w14 = default
      }
      frame "Update Display" {
        Property Node(instance in=s1) -> ("Alerts"=w17, instance out=w13)
        call "Parse Faults and Alerts.gviweb"(Alerts=w17) -> (Faults and alerts=w18)
        $"Faults and alerts" <- w18
        w12 = w11
        w14 = default
      }
      frame "Error" {
        call "Clear Error Cluster.gvi"(error in=w11) -> (error out=w12)
        Property Node(instance in=s1) -> ("Alerts"=w19, instance out=w20)
        Build Array(w19, w11) -> w21
        Property Node(instance in=w20, "Alerts"=w21) -> (instance out=w13)
        w14 = default
      }
      frame "Idle" {
        Merge Errors(w11) -> (error out=w12)
        w13 = s1
        w14 = default
      }
      frame "Exit" {
        Release Queue(error in=w11, queue=w8) -> (error out=w22)
        Generate User Event(event data=TRUE, user event=w3) -> (error out=w23)
        # Stop the VI
        Merge Errors(w23, w22) -> (error out=w12)
        w13 = s1
        w14 = TRUE
      }
      frame "Turn On Robot" {
        w12 = w11
        w13 = s1
        w14 = default
      }
      frame "Turn Off Robot" {
        w12 = w11
        w13 = s1
        w14 = default
      }
      frame "Patch" {
        w12 = w11
        w13 = s1
        w14 = default
      }
      frame "Rake" {
        w12 = w11
        w13 = s1
        w14 = default
      }
      frame "Retrieve Balls" {
        w12 = w11
        w13 = s1
        w14 = default
      }
      frame "Clear Alerts" {
        call "Enqueue Message (Single).gviweb"(message queue in=w8, message="Update Display", error in=w11) -> (error out=w12)
        Property Node(instance in=s1, "Alerts"=error[] []) -> (instance out=w13)
        w14 = default
      }
    }
    call "Error Handler - Message Handling Loop.gviweb"(message queue in=w8, error in=w12) -> (dup error in=w24)
    next s1 = w13
    stop if w14
  }
  Register For Events("Stop Event"=w3) -> (event registration refnum out=w25)
  s2 = w25  # shift register
  while {
    event (timeout = 100) (dynamic events = s2) {
      on "Dynamic" Stop Event {
        w26 = TRUE
        w27 = no error
        w28 = w7
      }
      on "Exit" Value changed {
        call "Enqueue Message (Single).gviweb"(priority message=TRUE, message queue in=w7, message="Exit") -> (message queue out=w28, error out=w27)
        w26 = default
      }
      on Timeout {
        w26 = default
        w27 = default
        w28 = w7
      }
      on "Robot ON/OFF" Value changed {
        Select(s=$"Robot ON/OFF", t="Turn On Robot", f="Turn Off Robot") -> w29
        call "Enqueue Message (Single).gviweb"(message queue in=w7, message=w29) -> (message queue out=w28, error out=w27)
        w26 = default
      }
      on "Clear Faults" Value changed {
        call "Enqueue Message (Single).gviweb"(message queue in=w7, message="Clear Alerts") -> (message queue out=w28, error out=w27)
        w26 = default
      }
    }
    call "Error Handler - Event Handling Loop.gviweb"(message queue in=w28, error in=w27) -> (dup error in=w30)
    stop if w26
  }
  Unregister For Events(error in=w30, event registration refnum=s2) -> (error out=w31)
  Merge Errors(w31, w24) -> (error out=w32)
  Destroy User Event(error in=w32, user event=w3)
